# Grasshopper definition Python3ConeVoxelization.gh (Grasshopper 1.0.7)
# plug-ins: RhinoCodePluginGH

cone = Cone(Base=PlaneXY(-2, -1, 0), Radius=Slider(2, range=0..10), Length=Slider(2, range=0..10))  # -> Cone, Tip
cap = CapHoles(Brep=cone.Cone)
pt = Point(Point(0, 0, 0))
vec = VectorXYZ(XComponent=Slider(0.3, range=0..1), YComponent=Slider(0.3, range=0..1), ZComponent=Slider(0.2, range=0..1))  # -> Vector, Length
brep = Brep(cap)
col = Colour(ColourSwatch(SwatchColor=RGB(255, 255, 255)))
S = Script(solid=brep, size=vec.Vector, r=Slider(7, range=0..10))  # -> out, a, b; inputs solid: Brep, size: Vector3d, r: Double
# ---------- S: Python ----------
"""Grasshopper Script"""
a = "Hello Python 3 in Grasshopper!"
print(a)
import Rhino.Geometry as rg

import Grasshopper as gh

a=rg.Point3d(4,5,6)
b=rg.Circle(a,r)

import sys
print(sys.version)
# ---------- end S ----------
crv = Curve(<curve referenced from the Rhino model>)
line = Line([Line((3, -26, 0), (3, -26, 6)), Line((10, -25, 0), (10, -12, 0))])
devec = DeconstructVector(Vector=vec.Vector)  # -> XComponent, YComponent, ZComponent
S_2 = Script(solid=brep, size=vec.Vector)  # -> out, a, b, c, d; inputs solid: Brep, size: Vector3d
# ---------- S_2: Python ----------
"""Grasshopper Script"""
a = "Hello Python 3 in Grasshopper!"
print(a)
import Rhino.Geometry as rg
import math
import Grasshopper as gh
print(type(solid))

RBBox=solid.GetBoundingBox(rg.Plane.WorldXY)#https://developer.rhino3d.com/api/rhinocommon/rhino.geometry.geometrybase/getboundingbox

print(RBBox.Min)
print(RBBox.Max)
(u,v,w)=(size.X,size.Y,size.Z)
diagonalR3=RBBox.Max-RBBox.Min
print(diagonalR3)
diagonalN3=(round(diagonalR3.X/size.X),round(diagonalR3.Y/size.Y),round(diagonalR3.Z/size.Z))
# here we make the minimimum corner in Z3
#creating a minimum corner voxel point in R3 so that the point (0,0,0) in R3 is mapped to (0,0,0) in Z3
minZ3=RBBox.Min
minZ3.X=round(minZ3.X/u)
minZ3.Y=round(minZ3.Y/v)
minZ3.Z=round(minZ3.Z/w)
minVoxel=rg.Point3d()
minVoxel.X=minZ3.X*u
minVoxel.Y=minZ3.Y*v
minVoxel.Z=minZ3.Z*w

(m,n,o)=diagonalN3
tol=10E-3
print(m,n,o)
print(type(m))
voxelPoints=[]
N3Voxels=[]
distances=[]
for i in range(m+1):
    for j in range(n+1):
        for k in range(o+1):
            voxelPoint=minVoxel+rg.Point3d(i*u,j*v,k*w)
            voxelPoints.append(voxelPoint)
            N3Voxels.append((i,j,k))
            cPoint=solid.ClosestPoint(voxelPoint)
            distance=cPoint.DistanceTo(voxelPoint)
            if (solid.IsPointInside(voxelPoint, tol, True)):
                distance=-distance
            distances.append(distance)
a=voxelPoints
d=distances

def HeatColourANum(num):
    grad=gh.GUI.Gradient.GH_Gradient.Heat()
    grad.Linear=True
    return grad.ColourAt(num)

def boxelAVoxel(voxelPoint, voxelSize):
    '''
    v7_____________v6  
    |\             |\  
    | \            | \  
    |  \ _____________\  
    |   v4         |   v5  
    |   |          |   |  
    |   |          |   |  
    v3--|----------v2  |  
     \  |           \  |  
      \ |            \ |  
       \|             \|  
        v0_____________v1
    '''
    u=voxelSize.X/2
    v=voxelSize.Y/2
    w=voxelSize.Z/2
    v0=voxelPoint+rg.Vector3d(-u,-v,-w)
    v1=voxelPoint+rg.Vector3d(+u,-v,-w)
    v2=voxelPoint+rg.Vector3d(+u,+v,-w)
    v3=voxelPoint+rg.Vector3d(-u,+v,-w)
    v4=voxelPoint+rg.Vector3d(-u,-v,+w)
    v5=voxelPoint+rg.Vector3d(+u,-v,+w)
    v6=voxelPoint+rg.Vector3d(+u,+v,+w)
    v7=voxelPoint+rg.Vector3d(-u,+v,+w)
    vertices=[v0,v1,v2,v3,v4,v5,v6,v7]
    box=rg.Mesh.CreateFromBox(vertices,1,1,1)
    return box
def cboxelAVoxel(voxelPoint, voxelSize, colour):
    '''
    v7_____________v6  
    |\             |\  
    | \            | \  
    |  \ _____________\  
    |   v4         |   v5  
    |   |          |   |  
    |   |          |   |  
    v3--|----------v2  |  
     \  |           \  |  
      \ |            \ |  
       \|             \|  
        v0_____________v1
    '''
    u=voxelSize.X/2
    v=voxelSize.Y/2
    w=voxelSize.Z/2
    v0=voxelPoint+rg.Vector3d(-u,-v,-w)
    v1=voxelPoint+rg.Vector3d(+u,-v,-w)
    v2=voxelPoint+rg.Vector3d(+u,+v,-w)
    v3=voxelPoint+rg.Vector3d(-u,+v,-w)
    v4=voxelPoint+rg.Vector3d(-u,-v,+w)
    v5=voxelPoint+rg.Vector3d(+u,-v,+w)
    v6=voxelPoint+rg.Vector3d(+u,+v,+w)
    v7=voxelPoint+rg.Vector3d(-u,+v,+w)
    vertices=[v0,v1,v2,v3,v4,v5,v6,v7]
    box=rg.Mesh.CreateFromBox(vertices,1,1,1)
    box.VertexColors.CreateMonotoneMesh(colour)
    return box
def remapNumbers(nums):
    #remaps numbers into a range starting from the minimum and ending with the maximum of the list
    remappedNs=[]
    maxN=max(nums)
    minN=min(nums)
    for num in nums:
        remappedN=(num-minN)/(maxN-minN)
        remappedNs.append(remappedN)
    return remappedNs
remappedDists=remapNumbers(distances)
colours=[]
for remappedDist in remappedDists:
    colour=HeatColourANum(remappedDist)
    colours.append(colour)
r=remappedDists#
colouredBoxes=[]
for i in range(len(distances)):
    colouredBox=cboxelAVoxel(voxelPoints[i],size,HeatColourANum(remappedDists[i]))
    colouredBoxes.append(colouredBox)
c=colouredBoxes
# ---------- end S_2 ----------
S_3 = Script(x=pt, d=S_2.d, y=col)  # -> out, a, b, c, virC; inputs x: Point3d, d: list of Double, y: Color
# ---------- S_3: Python ----------
"""Grasshopper Script"""
a = "Hello Python 3 in Grasshopper!"
print(a)
import sys
import System
print(sys.version)
print(sys.path)
print(sys.executable)

#https://discourse.mcneel.com/t/rhino-8-feature-scripteditor-cpython-csharp/128353/425

#https://discourse.mcneel.com/t/rhino-8-feature-scripteditor-cpython-csharp/128353/437?u=pirouz_nourian1
"""Testing pip install specific packages"""
# r: numpy
# r: matplotlib

import numpy as np
print(np.__version__)

print(np.zeros((3,3)))

a=np.zeros((3,3))

#documentation is available here: https://developer.rhino3d.com/api/rhinocommon/?version=8.x
import Rhino.Geometry as rg

#we will use GH only for making datatrees, if absolutely necessary, nothing else
import Grasshopper as gh
# get the grasshopper sdk by typing GrasshopperGetSDKDocumentation in your Rhino commandline

b=rg.Circle(x,10)
(m,n)=(3,4)
GDT=gh.DataTree[rg.Point3d]()
for i in range(m):
    GDT.EnsurePath(i)
    for j in range(n):
        point=rg.Point3d(i,j,0)
        GDT.Branch(i).Add(point)

c=GDT

from matplotlib import cm
# Get the 'viridis' colormap with 256 colors
viridis = cm.get_cmap('viridis', 256)

# Generate colors from the 'viridis' colormap
colors = viridis(np.linspace(0, 1, 256))
print(type(colors))

distArray=np.array(d)
a=distArray
def relativizeNP(valArray):
    valMin,valMax=(np.min(valArray),np.max(valArray))
    relVals=(valArray - valMin) / (valMax - valMin)
    return relVals

b=relativizeNP(distArray)
cols=viridis(relativizeNP(distArray))
colsRGB = np.delete(cols,3,axis=1)
colsRGB=(colsRGB*256).astype(int)

print(np.max(colsRGB,axis=0))

for col in colsRGB:
    #print(col)
    pass
sysCols=[System.Drawing.Color.FromArgb(int(colRGB[0]),int(colRGB[1]),int(colRGB[2])) for colRGB in colsRGB]
virC=sysCols
# ---------- end S_3 ----------

# ---- group: C# Code, for further information
S_4 = Script(S=brep, xS=devec.XComponent, yS=devec.YComponent, zS=devec.ZComponent)  # -> out, A, B, C; inputs S: Brep, xS: Double, yS: Double, zS: Double
# ---------- S_4: C# ----------
// Grasshopper Script Instance
using System;
using System.Collections;
using System.Collections.Generic;
using System.Drawing;

using Rhino;
using Rhino.Geometry;

using Grasshopper;
using Grasshopper.Kernel;
using Grasshopper.Kernel.Data;
using Grasshopper.Kernel.Types;

public class Script_Instance : GH_ScriptInstance
{
  /* 
    Members:
      RhinoDoc RhinoDocument
      GH_Document GrasshopperDocument
      IGH_Component Component
      int Iteration

    Methods (Virtual & overridable):
      Print(string text)
      Print(string format, params object[] args)
      Reflect(object obj)
      Reflect(object obj, string method_name)
  */
  
  private void RunScript(
	Brep S,
	double xS,
	double yS,
	double zS,
	out object A,
	out object B,
	out object C)
  {
    // Write your logic here
    // a = null;

    BoundingBox BBox = S.GetBoundingBox(true);

    double W = BBox.Diagonal.X;
    double L = BBox.Diagonal.Y;
    double H = BBox.Diagonal.Z;

    int UC = (int) System.Math.Ceiling(W / xS);
    int VC = (int) System.Math.Ceiling(L / yS);
    int WC = (int) System.Math.Ceiling(H / zS);
    A = WC;
    B = BBox;
    Plane bPlane = new Plane(BBox.Min, Vector3d.XAxis, Vector3d.YAxis);
    //int k = 0;

    double xShift = 0.5 * xS;
    double yShift = 0.5 * yS;
    double zShift = 0.5 * zS;
    List<Point3d> pointList = new List<Point3d>();
    List<double> distanceList = new List<double>();
    for(int i = 0; i < UC;i++){
      for(int j = 0; j < VC; j++){
        for(int k = 0; k < WC;k++){
          Point3d point = bPlane.PointAt(xShift + i * xS, yShift + j * yS, zShift + k * zS);
          pointList.Add(point);

          Point3d cPoint = S.ClosestPoint(point);
          double distance = cPoint.DistanceTo(point);
          if(!S.IsPointInside(point,0.1,true)){
            distance = -distance;
          }
          distanceList.Add(distance);


        }
      }
    }
    A = pointList;
    C = distanceList;
  }
}
# ---------- end S_4 ----------

# ----
divide = DivideCurve(Curve=line, Count=10, Kinks=False)  # -> Points, Tangents, Parameters
swatch = ColourSwatch(SwatchColor=RGB(76, 194, 168))
col_2 = Colour(S_3.virC)
pt_2 = Point(S_3.c)
panel = Panel(S_3.c)
pt_3 = Point(S_2.a)
mesh = Mesh(S_2.c)
box = CenterBox(Base=pt_3, X=expr("x/2", devec.XComponent), Y=expr("x/2", devec.YComponent), Z=expr("x/2", devec.ZComponent))
line_2 = LineSDL(Start=divide.Points, Direction=Vector(0, 0, 1), Length=1)
divide_2 = DivideCurve(Curve=line_2, Count=10, Kinks=False)  # -> Points, Tangents, Parameters
material = CreateMaterial(Diffuse=col_2, Specular=RGB(255, 255, 255), Emission=RGB(0, 0, 0), Transparency=Slider(0.2, range=0..1), Shine=0)
pt_4 = Point(divide.Points)
bnd = Bounds(Numbers=S_2.d)
panel_2 = Panel(divide_2.Points)
tstat = TreeStatistics(Tree=divide.Points)  # -> Paths, Length, Count
preview = CustomPreview(Geometry=box, Material=material)
dedomain = DeconstructDomain(Domain=bnd)  # -> Start, End
gradient = Gradient(
    LowerLimit=dedomain.Start,
    UpperLimit=dedomain.End,
    Parameter=S_2.d,
    stops=[0: RGB(234, 38, 0), 0.25: RGB(234, 126, 0), 0.5: RGB(254, 244, 84), 0.75: RGB(173, 203, 249), 1: RGB(75, 107, 169)])
legend = Legend(Colour=col_2, Tags=S_2.d, LegendType=1)
cloud = CloudDisplay(Points=pt_3, Colours=gradient, Size=0.2, SpriteType=0)
